# Grasshopper definition GHDebug.gh (Grasshopper 1.0.7)

# ---- group: BBox MakeitValid Method
pt = Point(Point(15, 15, 0))
pt_2 = Point(Point(5, 0, 0))
ln = Line(StartPoint=pt, EndPoint=pt_2)
end = EndPoints(Curve=ln)  # -> Start, End
panel = Panel([end.Start, end.End])
c_script = CSharpScript(l=ln)  # -> out, A; inputs l: Line
# ---------- c_script: C# ----------
    var bBox = l.BoundingBox;
    var bString = bBox.ToString();
    A = bBox.ToString();
# ---------- end c_script ----------
panel_2 = Panel(c_script.A)

# ---- group: ClosestPointToSegment
panel_3 = Panel("""{5,7,0}
{7,6,0}
{5,9,0}""")
panel_4 = Panel("""{5,5,0}
{10,10,0}
{5,7,0}""")
item = ListItem(List=panel_4, Index=0, Wrap=True)  # -> Item, Item1, Item2
ln_2 = Line(StartPoint=item.Item, EndPoint=item.Item1)
pt_3 = Point(panel_3)
crv_cp = CurveClosestPoint(Point=pt_3, Curve=ln_2)  # -> Point, Parameter, Distance
panel_5 = Panel(crv_cp.Point)
panel_6 = Panel(crv_cp.Parameter)

# ---- group: Arc and Circle / ToNurbs / Verb
panel_7 = Panel("""{74.264416,36.39316,-1.8843129999999997}
{63.73736394529969,26.774907230101093,0.7265431054950776}
{72.2808868605866,15.429871621311115,3.6324963299804987}
{80.8244097758736,4.084836012521206,6.538449554465901}
{93.52800280921122,10.812836698886068,4.6679117389561}
{106.23159584254901,17.54083738525103,2.797373923446271}
{100.92443,30.599893,-0.5851159999999997}""")
panel_8 = Panel("""1
0.7507927793532885
1
0.7507927793532885
1
0.7507927793532885
1""")
panel_9 = Panel("""0
0
0.3333333333333333
0.3333333333333333
0.6666666666666666
0.6666666666666666
1
1""")
pt_4 = Point(panel_7)
nurbcrv = NurbsCurvePWK(Points=pt_4, Weights=panel_8, Knots=panel_9)  # -> Curve, Length, Domain

# ---- group: PointAt
panel_10 = Panel("""0
0.15
0.36
0.85
1""")
ln_3 = Line(StartPoint=pt_2, EndPoint=pt)
eval = EvaluateCurve(Curve=ln_3, Parameter=panel_10)  # -> Point, Tangent, Angle
panel_11 = Panel(eval.Point)

# ---- group: Flip
vec = Vector(ln_3)
pl = PlaneNormal(Origin=pt_2, ZAxis=vec)
pflip = FlipPlane(Plane=pl, ReverseX=False, ReverseY=False, SwapAxes=True)
deplane = DeconstructPlane(Plane=pl)  # -> Origin, XAxis, YAxis, ZAxis
panel_12 = Panel([deplane.Origin, deplane.XAxis, deplane.YAxis, deplane.ZAxis])

# ---- group: Plane 3Pts
pt_5 = Point(Point(5, 5, 0))
pt_6 = Point(Point(-5, 10, 0))
pt_7 = Point(Point(20, 20, 0))
pl_3pt = Plane3Pt(PointA=pt_7, PointB=pt_5, PointC=pt_6)
deplane_2 = DeconstructPlane(Plane=pl_3pt)  # -> Origin, XAxis, YAxis, ZAxis
panel_13 = Panel([deplane_2.Origin, deplane_2.XAxis, deplane_2.YAxis, deplane_2.ZAxis])

# ----
X = UnitX(Factor=1)

# ---- group: Transformation
rad = Radians(Degrees="30")
move = Move(Motion=ln_3)  # -> Geometry, Transform
rotate = Rotate(Angle=rad, Plane=PlaneXY(0, 0, 0))  # -> Geometry, Transform
comp = Compound(Transforms=[rotate.Transform, move.Transform])
transform = Transform(Geometry=pl_3pt, Transform=comp)
deplane_3 = DeconstructPlane(Plane=transform)  # -> Origin, XAxis, YAxis, ZAxis
panel_14 = Panel([deplane_3.Origin, deplane_3.XAxis, deplane_3.YAxis, deplane_3.ZAxis])

# ----
X_2 = UnitX(Factor=1)
addition = Addition(A=deplane_2.Origin, B=X)
align = AlignPlane(Plane=pl_3pt, Direction=X_2)  # -> Plane, Angle
pt_8 = Point(addition)
plcoord = PlaneCoordinates(Point=pt_8, System=pl_3pt)  # -> XCoordinate, YCoordinate, ZCoordinate

# ---- group: Amplitude
panel_15 = Panel("""{5,5,0}
{10,10,0}
{20,15,0}
{35,15,0}""")
panel_16 = Panel("""0
15
33
46""")
amp = Amplitude(Vector=panel_15, Amplitude=panel_16)
panel_17 = Panel(amp)

# ----
expression = Expression(x=plcoord.XCoordinate, y=plcoord.YCoordinate, Expression="Atan2(x,y)")

# ---- group: RationCurveClosestParameter
panel_18 = Panel("""{5,7,0}
{12,10,0}
{21,17,0}
{32,15,0}
{41,8,0}
{50,5,0}""")
panel_19 = Panel("""{5,5,0}
{10,10,0}
{20,15,0}
{35,15,0}
{45,10,0}
{50,5,0}""")
pt_9 = Point(panel_18)
nurbs = NurbsCurve(Vertices=panel_19, Degree="3", Periodic=False)  # -> reparameterize(Curve), Length, Domain
crv_cp_2 = CurveClosestPoint(Point=pt_9, Curve=nurbs.Curve)  # -> Point, Parameter, Distance
panel_20 = Panel(crv_cp_2.Parameter)
panel_21 = Panel(crv_cp_2.Point)

# ----
deg = Degrees(Radians=expression)
panel_22 = Panel(deg)

# ---- group: Rotation
prot = RotatePlane(Plane=pl_3pt, Angle=rad)
deplane_4 = DeconstructPlane(Plane=align.Plane)  # -> Origin, XAxis, YAxis, ZAxis
panel_23 = Panel([deplane_4.Origin, deplane_4.XAxis, deplane_4.YAxis, deplane_4.ZAxis])

# ---- group: PythonNurbsLinearSpace
python = GhPythonScript()  # -> out, a
# ---------- python: Python ----------
__author__ = "m.bianchini"
__version__ = "2021.01.09"

import rhinoscriptsyntax as rs


def linspace(start, stop, num, decimals=18):
    """ Returns a list of evenly spaced numbers over a specified interval.
    Inspired from Numpy's linspace function: https://github.com/numpy/numpy/blob/master/numpy/core/function_base.py
    :param start: starting value
    :type start: float
    :param stop: end value
    :type stop: float
    :param num: number of samples to generate
    :type num: int
    :param decimals: number of significands
    :type decimals: int
    :return: a list of equally spaced numbers
    :rtype: list
    """
    start = float(start)
    stop = float(stop)
    if abs(start - stop) <= 10e-8:
        return [start]
    num = int(num)
    if num > 1:
        div = num - 1
        delta = stop - start
        return [float(("{:." + str(decimals) + "f}").format((start + (float(x) * float(delta) / float(div)))))
                for x in range(num)]
    return [float(("{:." + str(decimals) + "f}").format(start))]
    
a = linspace(0.0,1.0,8)
# ---------- end python ----------
panel_24 = Panel(python.a)

# ---- group: CollinearPts using triangle area without square the area and divided
pt_10 = Point(<point referenced from the Rhino model>)
pt_11 = Point(<point referenced from the Rhino model>)
pt_12 = Point(<point referenced from the Rhino model>)
subtraction = Subtraction(A=pt_12, B=pt_10)
subtraction_2 = Subtraction(A=pt_11, B=pt_10)
pline = PolyLine(Vertices=[pt_10, pt_11, pt_12], Closed=True)
xprod = CrossProduct(VectorA=subtraction_2, VectorB=subtraction, Unitize=False)  # -> Vector, Length
area = Area(Geometry=pline)  # -> Area, Centroid
dprod = DotProduct(VectorA=xprod.Vector, VectorB=xprod.Vector, Unitize=False)
sqrt = SquareRoot(Value=dprod)
division = Division(A=sqrt, B=2)
multiplication = Multiplication(A=sqrt, B=0.5)
panel_25 = Panel([dprod, area.Area, division, multiplication])

# ---- group: Unitized
vec_2 = Vector(Vector(15.19032948, 29.8990158, 0))
vlen = VectorLength(Vector=vec_2)
division_2 = Division(A=1, B=vlen)
unit = UnitVector(Vector=vec_2)
multiplication_2 = Multiplication(A=vec_2, B=division_2)
vdis = VectorDisplay(Anchor=Point(0.1183940464, -0.03405877464, 0), Vector=[vec_2, unit])

# ---- group: Polygon
panel_26 = Panel("""{74.264416, 36.39316, -1.884313}
{79.65881, 22.402983, 1.741763}
{97.679126, 13.940616, 3.812853}
{100.92443, 30.599893, -0.585116}
{78.805261, 45.16886, -4.22451}
{74.264416, 36.39316, -1.884313}""")
pline_2 = PolyLine(Vertices=panel_26, Closed=False)
panel_27 = Panel("""{1,1,0} 
{10,1,0} 
{2,10,0} 
{1,10,0} 
{1,1,0}""")
pcen = PolygonCenter(Polyline=pline_2)  # -> CenterV, CenterE, CenterA
cp = ControlPoints(Curve=pline_2)  # -> Points, Weights, Knots
c_script_2 = CSharpScript(poly=pline_2)  # -> out, A; inputs poly: Polyline
# ---------- c_script_2: C# ----------
    A = poly.ToNurbsCurve();
# ---------- end c_script_2 ----------
plfit = PlaneFit(Points=cp.Points)  # -> Plane, Deviation
cp_2 = ControlPoints(Curve=reparameterize(c_script_2.A))  # -> Points, Weights, Knots
pl_origin = PlaneOrigin(Base=plfit.Plane, Origin=pcen.CenterV)
pline_3 = PolyLine(Vertices=panel_27, Closed=True)
panel_28 = Panel(cp_2.Knots)
panel_29 = Panel(cp_2.Points)
cp_3 = PlaneClosestPoint(Point=cp.Points, Plane=pl_origin)  # -> Point, UVPoint, Distance
pcen_2 = PolygonCenter(Polyline=pline_3)  # -> CenterV, CenterE, CenterA
deplane_5 = DeconstructPlane(Plane=pl_origin)  # -> Origin, XAxis, YAxis, ZAxis
area_2 = Area(Geometry=pline_3)  # -> Area, Centroid
pt_13 = Point(pcen_2.CenterA)
sort = SortList(Keys=cp_3.Distance, ValuesA=cp_3.Point)  # -> reverse(Keys), reverse(ValuesA)
rev = Reverse(Vector=deplane_5.ZAxis)
vdis_2 = VectorDisplay(Anchor=deplane_5.Origin, Vector=rev)
panel_30 = Panel([deplane_5.Origin, deplane_5.ZAxis])
pt_14 = Point(sort.ValuesA)

# ---- group: ReverseKnotsNurbsPython
python_2 = GhPythonScript()  # -> out, a
# ---------- python_2: Python ----------
__author__ = "m.bianchini"
__version__ = "2021.02.02"

import rhinoscriptsyntax as rs

kv = [0, 0, 0, 0, 1, 1, 2, 2, 2, 3, 3.3, 4, 4, 4]

max_k = kv[-1]
new_kv = [max_k - k for k in kv]

a = list(reversed(new_kv))
# ---------- end python_2 ----------
panel_31 = Panel(python_2.a)

# ---- group: DivideByLength
panel_32 = Panel("""{5,5,0}
{10,10,0}
{20,15,0}
{35,15,0}
{45,10,0}
{50,5,0}""")
panel_33 = Panel("""0
15
33
46""")
nurbs_2 = NurbsCurve(Vertices=panel_32, Degree="3", Periodic=False)  # -> reparameterize(Curve), Length, Domain
len = Length(Curve=nurbs_2.Curve)
merge = Merge(Data1=panel_33, Data2=len)
eval_2 = EvaluateLength(Curve=nurbs_2.Curve, Length=merge, Normalized=False)  # -> Point, Tangent, Parameter
panel_34 = Panel(eval_2.Parameter)

# ---- group: Polyline
panel_35 = Panel("""{0, 0, 0}
{150, 50, 0}
{300, 0, 0}""")
panel_36 = Panel("""{5,5,0}
{5,10,0}
{5,15,0}
{15,12,0}
{20,-25,0}
{20,-20,0}""")
panel_37 = Panel("""{5, 0, 0}
{15, 15, 0}
{20, 5, 0}
{30, 10, 0} 
{45, 12.5, 0}""")
panel_38 = Panel("""0.0
0.25
0.55
1.0""")
pt_15 = Point(panel_35)
pt_16 = Point("{17, 8, 0}")
pline_4 = PolyLine(Vertices=pt_15, Closed=False)
explode = Explode(Curve=pline_4, Recursive=True)  # -> Segments, Vertices
len_2 = Length(Curve=pline_4)
eval_3 = EvaluateCurve(Curve=reparameterize(pline_4), Parameter=panel_38)  # -> Point, Tangent, Angle
transform_2 = Transform(Geometry=pline_4, Transform=comp)
explode_2 = Explode(Curve=transform_2, Recursive=True)  # -> Segments, Vertices
panel_39 = Panel(eval_3.Point)
panel_40 = Panel(len_2)
dist = Distance(PointA=explode.Vertices, PointB=explode_2.Vertices)
bbox = BoundingBox(Content=pline_4, Plane=PlaneXY(0, 0, 0))  # -> Box, Box_2
crv_cp_3 = CurveClosestPoint(Point=pt_16, Curve=pline_4)  # -> Point, Parameter, Distance
panel_41 = Panel(eval_3.Tangent)
panel_42 = Panel(dist)
box_corners = BoxCorners(Box=bbox.Box)  # -> CornerA, CornerB, CornerC, CornerD, CornerE, CornerF, CornerG, CornerH
panel_43 = Panel(crv_cp_3.Point)
panel_44 = Panel([box_corners.CornerA, box_corners.CornerC])

# ---- group: CurveDerivatives
python_3 = GhPythonScript(x=Slider(2, range=0..2))  # -> out, a; inputs x: Int32
# ---------- python_3: Python ----------
__author__ = "m.bianchini"
__version__ = "2021.01.19"

import rhinoscriptsyntax as rs
basis = [[0,0,1],[0,-2,2],[2,-4,2]]
ctrlpts = [[1,0,0,1],[1,1,0,1],[0,2,0,2]]

eval_points = []
for idx in range(2+1):
    crvpt = [0.0 for _ in range(4)]
    for i in range(0, 2 + 1):
        crvpt[:] = [crv_p + (basis[idx][i] * ctl_p) for crv_p, ctl_p in
                    zip(crvpt, ctrlpts[2 - 2 + i])]

    eval_points.append(crvpt)

eval_points.append(crvpt)

a = eval_points[x]
# ---------- end python_3 ----------
panel_45 = Panel(python_3.a)

# ---- group: PlaneFromNormal
pt_17 = ConstructPoint(XCoordinate="-7", YCoordinate="10", ZCoordinate="-5")
pt_18 = ConstructPoint(XCoordinate=0, YCoordinate=0, ZCoordinate=0)
c_script_3 = CSharpScript(x=pt_17)  # -> out, A; inputs x: Vector3d
# ---------- c_script_3: C# ----------
    var yAxis = Vector3d.YAxis;
    yAxis.PerpendicularTo(x);
    A = yAxis;
# ---------- end c_script_3 ----------
pl_2 = PlaneNormal(Origin=pt_18, ZAxis=pt_17)
deplane_6 = DeconstructPlane(Plane=pl_2)  # -> Origin, XAxis, YAxis, ZAxis
vdis_3 = VectorDisplay(Anchor=pt_18, Vector=[deplane_6.YAxis, c_script_3.A])
panel_46 = Panel(deplane_6.XAxis)
panel_47 = Panel(c_script_3.A)

# ---- group: CurvesIntersection
panel_48 = Panel("""{ 2.225594, 1.226218, 2.01283}
{ 8.681402, 4.789645, 5.010206}
{ 6.181402, 4.789645, 0.010206}
{ 1.181402, 7.289645, 5.010206}
{ 8.496731, 9.656647, 2.348212}""")
panel_49 = Panel("""{-5,0,0}
{5,-1,0}
{10,5,0}
{3,10,0}
{5, 12, 0}""")
panel_50 = Panel("""{-5,0,0}
{10,0,0}
{10,10,0}
{0,10,0}
{5, 5, 0}""")
panel_51 = Panel("""{0, 0, 0}
{5, 2.5, 5}
{5, 5, 0}
{7.5, 10, 5}
{10, 10, 0}""")
panel_52 = Panel("""1
1
1
1
1""")
panel_53 = Panel("""1
1
1
1
1""")
panel_54 = Panel("""0.0
0.0 
0.0 
0.5
1.0 
1.0
1.0""")
panel_55 = Panel("""0.0
0.0 
0.0 
0.5
1.0 
1.0
1.0""")
nurbcrv_2 = NurbsCurvePWK(Points=panel_49, Weights=panel_52, Knots=panel_54)  # -> reparameterize(Curve), Length, Domain
nurbcrv_3 = NurbsCurvePWK(Points=panel_50, Weights=panel_52, Knots=panel_54)  # -> reparameterize(Curve), Length, Domain
nurbcrv_4 = NurbsCurvePWK(Points=panel_48, Weights=panel_53, Knots=panel_55)  # -> reparameterize(Curve), Length, Domain
nurbcrv_5 = NurbsCurvePWK(Points=panel_51, Weights=panel_53, Knots=panel_55)  # -> reparameterize(Curve), Length, Domain
ccx = CurveCurve(CurveA=nurbcrv_3.Curve, CurveB=nurbcrv_2.Curve)  # -> Points, ParamsA, ParamsB
ccx_2 = CurveCurve(CurveA=nurbcrv_5.Curve, CurveB=nurbcrv_4.Curve)  # -> Points, ParamsA, ParamsB
panel_56 = Panel(ccx_2.Points)
panel_57 = Panel(ccx.ParamsA)

# ---- group: LineLine
ln_4 = Line(StartPoint="{-5,5,0}", EndPoint="{5,5,5}")
ln_5 = Line(StartPoint="{0,0,0}", EndPoint="{3,3,2}")
ln_6 = Line(StartPoint="{0,0,0}", EndPoint="{0,20,0}")
ln_7 = Line(StartPoint="{-5,5,0}", EndPoint="{5,5,0}")
llx = LineLine(Line1=ln_4, Line2=ln_5)  # -> ParamA, ParamB, PointA, PointB
panel_58 = Panel([llx.PointA, llx.PointB])

# ---- group: CurvePlaneIntersection
panel_59 = Panel("""{0,0,0}
{0.5,0.5,0}
{2,0,0}""")
panel_60 = Panel("""1
1
1""")
panel_61 = Panel("""{0.25,0,0}
{0.75,0,0}
{1,0,0}
{1.75,0,0}""")
panel_62 = Panel("""0.0
0.0
1.0
1.0""")
pt_19 = Point("{6,0,0}")
yz = YZPlane(Origin=pt_19)
pt_20 = Point(panel_61)
nurbcrv_6 = NurbsCurvePWK(Points=panel_59, Weights=panel_60, Knots=panel_62)  # -> reparameterize(Curve), Length, Domain
yz_2 = YZPlane(Origin=pt_20)
rotate_2 = Rotate(Geometry=yz, Angle="0.15", Plane=PlaneXY(0, 0, 0))  # -> Geometry, Transform
pcx = CurvePlane(Curve=nurbcrv_4.Curve, Plane=rotate_2.Geometry)  # -> Points, ParamsC, ParamsP
pcx_2 = CurvePlane(Curve=nurbcrv_6.Curve, Plane=yz_2)  # -> Points, ParamsC, ParamsP
panel_63 = Panel([pcx_2.Points, pcx_2.ParamsC])
panel_64 = Panel([pcx.Points, pcx.ParamsC, pcx.ParamsP])

# ---- group: SelfIntersection
panel_65 = Panel("""{0, 5, 0}
{2.5, 0, 0}
{5, 2.5, 0}
{2.5, 5, 0}
{0, 0, 0}
{5, 0, 0}
{2.5, 5, 0}""")
panel_66 = Panel("""1
1
1
1
1
1
1""")
panel_67 = Panel("""{0, 5, 5}
{2.5, 0, 0}
{5, 5, 2.5}
{2.5, 5, 5}
{0, 0, 0}""")
panel_68 = Panel("""1
1
1
1
1""")
panel_69 = Panel("""0.0
0.0
0.0
0.25
0.5
0.75
1.0
1.0
1.0""")
panel_70 = Panel("""0.0
0.0
0.0
0.5
1.0
1.0
1.0""")
nurbcrv_7 = NurbsCurvePWK(Points=panel_65, Weights=panel_66, Knots=panel_69)  # -> reparameterize(Curve), Length, Domain
nurbcrv_8 = NurbsCurvePWK(Points=panel_67, Weights=panel_68, Knots=panel_70)  # -> reparameterize(Curve), Length, Domain
cx = CurveSelf(Curve=nurbcrv_7.Curve)  # -> Points, Params
cx_2 = CurveSelf(Curve=nurbcrv_8.Curve)  # -> Points, Params
panel_71 = Panel(cx.Params)
panel_72 = Panel(cx_2.Points)

# ---- group: Srf
number_slider = Slider(0.5, range=0..1)
pt_21 = Point(<point referenced from the Rhino model>)
pt_22 = Point(<point referenced from the Rhino model>)
pt_23 = Point(<point referenced from the Rhino model>)
pt_24 = Point(<point referenced from the Rhino model>)
pt_25 = Point(Point(30, -20, 0))
pt_26 = Point(Point(20, -20, 0))
pt_27 = Point(Point(10, -10, 10))
pt_28 = Point(Point(20, -10, 0))
pt_29 = Point(Point(30, -10, 0))
pt_30 = Point(Point(0, 0, 0))
pt_31 = Point(Point(10, -20, 0))
pt_32 = Point(Point(0, -10, 0))
pt_33 = Point(Point(30, 0, 0))
pt_34 = Point(Point(0, -30, 0))
pt_35 = Point(Point(20, 0, 0))
pt_36 = Point(Point(10, 0, 0))
pt_37 = Point(Point(0, -20, 0))
pt_38 = Point(Point(10, -30, 0))
pt_39 = Point(Point(20, -30, 0))
pt_40 = Point(Point(30, -30, 0))
srf4pt = _4PointSurface(CornerA=pt_21, CornerB=pt_22, CornerC=pt_24, CornerD=pt_23)
pt_41 = ConstructPoint(XCoordinate=number_slider, YCoordinate=number_slider, ZCoordinate=0)
panel_73 = Panel([pt_37, pt_31, pt_26, pt_25])
panel_74 = Panel([pt_34, pt_38, pt_39, pt_40])
evalsrf = EvaluateSurface(Surface=reparameterize(srf4pt), Point=pt_41)  # -> Point, Normal, UDirection, VDirection, Frame
panel_75 = Panel([pt_32, pt_27, pt_28, pt_29])
panel_76 = Panel([pt_30, pt_36, pt_35, pt_33])
panel_77 = Panel(evalsrf.Point)
iso = IsoCurve(Surface=reparameterize(srf4pt), UVPoint=pt_41)  # -> UIsocurve, VIsocurve
number_slider_2 = Slider(0.5, range=0..1)
srfgrid = SurfaceFromPoints(Points=[panel_76, panel_75, panel_73, panel_74], UCount="4", Interpolate=False)
pt_42 = ConstructPoint(XCoordinate="0.2", YCoordinate="0.2", ZCoordinate=0)
pt_43 = ConstructPoint(XCoordinate=number_slider_2, YCoordinate=number_slider_2, ZCoordinate=0)
evalsrf_2 = EvaluateSurface(Surface=srfgrid, Point=pt_43)  # -> Point, Normal, UDirection, VDirection, Frame
iso_2 = IsoCurve(Surface=reparameterize(srfgrid), UVPoint=pt_42)  # -> UIsocurve, VIsocurve
panel_78 = Panel(evalsrf_2.Point)
eval_4 = EvaluateCurve(Curve=iso_2.VIsocurve, Parameter="0.3")  # -> Point, Tangent, Angle
eval_5 = EvaluateCurve(Curve=iso_2.UIsocurve, Parameter=[number_slider_2, "0.2"])  # -> Point, Tangent, Angle
panel_79 = Panel(eval_4.Point)
panel_80 = Panel(eval_5.Point)

# ---- group: TestOnCurve
panel_81 = Panel("""{5,5,0}
{10,10,0}
{20,15,0}
{35,15,0}
{45,10,0}
{50,5,0}""")
panel_82 = Panel("""{5,5,0}
{20,15,0}
{35,15,0}
{50,5,0}""")
panel_83 = Panel("""{0,0,0}
{20,0,0}
{20,20,0}
{40,20,0}""")
panel_84 = Panel("3")
pt_44 = Point(panel_82)
pt_45 = Point(panel_81)
pt_46 = Point(panel_83)
number_slider_3 = Slider(0.36, range=0..1)
nurbs_3 = NurbsCurve(Vertices=pt_45, Degree=panel_84, Periodic=False)  # -> reparameterize(Curve), Length, Domain
fit = FitCurve(Curve=nurbs_3.Curve, Degree=2, Tolerance="0.001")
cp_4 = ControlPoints(Curve=fit)  # -> Points, Weights, Knots
len_3 = Length(Curve=nurbs_3.Curve)
# All these definitions were used to convalidate and developed the GeometrySharp tests.
panel_85 = Panel("7")
cp_5 = ControlPoints(Curve=nurbs_3.Curve)  # -> Points, Weights, Knots
crv_cp_4 = CurveClosestPoint(Point=cp_4.Points, Curve=nurbs_3.Curve)  # -> Point, Parameter, Distance
lng = ListLength(List=cp_4.Points)
division_3 = Division(A=nurbs_3.Length, B=panel_85)
crv_cp_5 = CurveClosestPoint(Point=crv_cp_4.Point, Curve=fit)  # -> Point, Parameter, Distance
c_script_4 = CSharpScript(V=pt_45, t=number_slider_3, d=panel_84, Reference="D:\MyFolder\VerbNurbs\verb\build\cs\bin\Verb.dll")  # -> out, PT, VE, o; inputs V: list of Vector3d, t: Double, d: Int32
# ---------- c_script_4: C# usings ----------
using verb.core;
using System.Linq;
# ---------- c_script_4: C# ----------
    var pts = new Array<object>();
    for (int i = 0; i < V.Count; i++)
      pts.push(new Array<double>(new double[] { V[i].X, V[i].Y, V[i].Z }));

    var curve = verb.geom.NurbsCurve.byPoints(pts, d);

    var ptAt = curve.point(t);
    var vec = verb.core.Vec.normalized(curve.tangent(t));

    PT = ToPoint(ptAt);
    VE = ToPoint(vec);
    o = curve.knots();
# ---------- c_script_4: C# additional code ----------
  public Point3d ToPoint(Array<double> pt)
  {
    var X = System.Math.Round(double.IsNaN(pt[0]) ? 0 : pt[0], 6);
    var Y = System.Math.Round(double.IsNaN(pt[1]) ? 0 : pt[1], 6);
    var Z = System.Math.Round(double.IsNaN(pt[2]) ? 0 : pt[2], 6);
    return new Point3d(X, Y, Z);
  }
# ---------- end c_script_4 ----------
eval_6 = EvaluateCurve(Curve=nurbs_3.Curve, Parameter=number_slider_3)  # -> Point, Tangent, Angle
divide = DivideCurve(Curve=nurbs_3.Curve, Count=panel_85, Kinks=False)  # -> Points, Tangents, Parameters
divlength = DivideLength(Curve=nurbs_3.Curve, Length=division_3)  # -> Points, Tangents, Parameters
shift = ShiftList(List=crv_cp_5.Parameter, Shift=1, Wrap=True)
panel_86 = Panel(divide.Parameters)
subtraction_3 = Subtraction(A=shift, B=crv_cp_5.Parameter)
panel_87 = Panel(subtraction_3)

# ---- group: TestOnCurve / VerbTest
c_script_5 = CSharpScript(
    V=cp_5.Points,
    W=cp_5.Weights,
    K=cp_5.Knots,
    t=number_slider_3,
    d=panel_84,
    Reference="D:\MyFolder\VerbNurbs\verb\build\cs\bin\Verb.dll")  # -> out, PT, VE, o; inputs V: list of Vector3d, W: list of Double, K: list of Double, t: Double, d: Int32
# ---------- c_script_5: C# ----------
    var pts = new Array<object>();
    var newKnots = new List<double>();
    newKnots.Add(K[0]);
    newKnots.AddRange(K);
    newKnots.Add(K[K.Count - 1]);
    o = newKnots;

    for (int i = 0; i < V.Count; i++)
      pts.push(new Array<double>(new double[] { V[i].X, V[i].Y, V[i].Z }));

    var knots = new Array<double>(newKnots.ToArray());
    var weights = new Array<double>(W.ToArray());

    var curve = verb.geom.NurbsCurve.byKnotsControlPointsWeights(d, knots, pts, weights);

    var ptAt = curve.point(t);
    var vec = verb.core.Vec.normalized(curve.tangent(t));

    PT = ToPoint(ptAt);
    VE = ToPoint(vec);
# ---------- c_script_5: C# additional code ----------
  public Point3d ToPoint(Array<double> pt)
  {
    var X = System.Math.Round(double.IsNaN(pt[0]) ? 0 : pt[0], 6);
    var Y = System.Math.Round(double.IsNaN(pt[1]) ? 0 : pt[1], 6);
    var Z = System.Math.Round(double.IsNaN(pt[2]) ? 0 : pt[2], 6);
    return new Point3d(X, Y, Z);
  }
# ---------- end c_script_5 ----------

# ---- group: TestOnCurve (continued)
panel_88 = Panel([eval_6.Point, c_script_5.PT, c_script_4.PT])
panel_89 = Panel([eval_6.Tangent, c_script_5.VE])
vdis_4 = VectorDisplay(Anchor=c_script_5.PT, Vector=c_script_5.VE)

# ---- group: Arc and Circle
panel_90 = Panel("""{ 85.591741, 24.79606, 1.064717 }
{ 82.248292, 15.836914, 3.443127 }""")
c_script_6 = CSharpScript(x="-30")  # -> out, A, B; inputs x: Double
# ---------- c_script_6: C# ----------
    A = AngularDiff(0, Rhino.RhinoMath.ToRadians(x));
# ---------- c_script_6: C# additional code ----------
  private double AngularDiff(double theta1, double theta2)
  {
    double dif = theta2 - theta1;
    while (dif >= 2 * Math.PI)
      dif -= 2 * Math.PI;
    while (dif <= 0)
      dif += 2 * Math.PI;
    return dif;
  }
# ---------- end c_script_6 ----------
deg_2 = Degrees(Radians=c_script_6.A)
panel_91 = Panel("""{74.264416, 36.39316, -1.884313}
{97.679126, 13.940616, 3.812853}
{100.92443, 30.599893, -0.585116}""")
panel_92 = Panel(deg_2)
pt_47 = Point(panel_90)
panel_93 = Panel("""0.0
0.1
0.324263""")
panel_94 = Panel("""0.0
1.2
2.5""")
item_2 = ListItem(List=panel_91, Index=0, Wrap=True)  # -> Item, Item1, Item2
rad_2 = Radians(Degrees="450")
c_script_7 = CSharpScript(pt1=item_2.Item, pt2=item_2.Item1, pt3=item_2.Item2)  # -> out, A, B; inputs pt1: Point3d, pt2: Point3d, pt3: Point3d
# ---------- c_script_7: C# ----------
    Arc a = new Arc(pt1, pt2, pt3);
    A = a.AngleDomain;
    B = a.ToNurbsCurve();
# ---------- end c_script_7 ----------
xy = XYPlane(Origin=Point(0, 0, 0))
arc = Arc3Pt(PointA=item_2.Item, PointB=item_2.Item1, PointC=item_2.Item2)  # -> Arc, Plane, Radius
X_3 = UnitX(Factor=1)
dom = ConstructDomain(DomainStart="0", DomainEnd=rad_2)
dedomain = DeconstructDomain(Domain=c_script_7.A)  # -> Start, End
X_4 = Point(item_2.Item1)
F = Point(item_2.Item2)
E = Point(item_2.Item)
deg_3 = Degrees(Radians=dedomain.End)
pln = Plane(arc.Plane)
cir = Circle(Plane=pln, Radius="23")
eval_7 = EvaluateCurve(Curve=reparameterize(cir), Parameter=panel_93)  # -> Point, Tangent, Angle
len_4 = Length(Curve=cir)
align_2 = AlignPlane(Plane=pln, Direction=X_3)  # -> Plane, Angle
len_5 = Length(Curve=arc.Arc)
c_script_8 = CSharpScript(pt1=item_2.Item2, plane=pln)  # -> out, A, B; inputs pt1: Point3d, plane: Plane
# ---------- c_script_8: C# ----------
    double x = 0.0;
    double y = 0.0;

    plane.ClosestParameter(pt1, out x, out y);

    Interval a = new Interval(x, y);
    double t = Math.Atan2(y, x);
    if ( t < 0.0 )
      t += 2.0 * Math.PI;
    A = t;
    B = a;
# ---------- end c_script_8 ----------
crv_cp_6 = CurveClosestPoint(Point=pt_47, Curve=reparameterize(cir))  # -> Point, Parameter, Distance
deplane_7 = DeconstructPlane(Plane=pln)  # -> Origin, XAxis, YAxis, ZAxis
arc_2 = Arc3Pt(PointA=E, PointB=X_4, PointC=F)  # -> Arc, Plane, Radius
X_5 = UnitX(Factor=1)
deplane_8 = DeconstructPlane(Plane=align_2.Plane)  # -> Origin, XAxis, YAxis, ZAxis
crv_cp_7 = CurveClosestPoint(Point=pt_47, Curve=reparameterize(arc.Arc))  # -> Point, Parameter, Distance
arc_3 = Arc(Plane=xy, Radius="15", Angle=dom)  # -> Arc, Length
panel_95 = Panel([deplane_8.Origin, deplane_8.XAxis, deplane_8.YAxis, deplane_8.ZAxis])
align_3 = AlignPlane(Plane=arc_2.Plane, Direction=X_5)  # -> Plane, Angle
num = Number(arc_3.Length)
panel_96 = Panel([deplane_7.Origin, deplane_7.XAxis, deplane_7.YAxis, deplane_7.ZAxis])
bbox_2 = BoundingBox(Content=cir, Plane=PlaneXY(0, 0, 0))  # -> Box, Box_2
C = Point(arc_2.Plane)
panel_97 = Panel([c_script_8.A, c_script_8.B])
panel_98 = Panel(crv_cp_6.Point)
box_corners_2 = BoxCorners(Box=bbox_2.Box)  # -> CornerA, CornerB, CornerC, CornerD, CornerE, CornerF, CornerG, CornerH
c_script_9 = CSharpScript(R=arc_2.Radius, P=align_3.Plane, E=E, C=C, F=F)  # -> out, A; inputs R: Double, P: Plane, E: Point3d, C: Point3d, F: Point3d
# ---------- c_script_9: C# ----------
    // Now consider the top/bottom/left/right extremities of the circle:
    double thetaE = Math.Atan2(E.Y - C.Y, E.X - C.X);
    double thetaF = Math.Atan2(F.Y - C.Y, F.X - C.X);

    List<Point3d> pts = new List<Point3d>();
    if (AnglesInClockwiseSequence(thetaE, 0/*right*/, thetaF))
    {
      pts.Add(P.Origin + P.XAxis * R);
    }
    if (AnglesInClockwiseSequence(thetaE, Math.PI / 2/*bottom*/, thetaF))
    {
      pts.Add(P.Origin + P.YAxis * R);
    }
    if (AnglesInClockwiseSequence(thetaE, Math.PI/*left*/, thetaF))
    {
      pts.Add(P.Origin - P.XAxis * R);
    }
    if (AnglesInClockwiseSequence(thetaE, Math.PI * 3 / 2/*top*/, thetaF))
    {
      pts.Add(P.Origin - P.YAxis * R);
    }

    A = pts;
# ---------- c_script_9: C# additional code ----------
  public static bool AnglesInClockwiseSequence(double x, double y, double z)
  {
    return AngularDiffSigned(x, y) + AngularDiffSigned(y, z) < 2 * Math.PI;
  }

  public static double AngularDiffSigned(double theta1, double theta2)
  {
    double dif = theta2 - theta1;
    while (dif >= 2 * Math.PI)
      dif -= 2 * Math.PI;
    while (dif <= 0)
      dif += 2 * Math.PI;
    return dif;
  }
# ---------- end c_script_9 ----------
orient = Orient(Geometry=arc.Arc, Source=pln, Target=PlaneXY(0, 0, 0))  # -> Geometry, Transform
pt_48 = Point(box_corners_2.CornerA)
pt_49 = Point(box_corners_2.CornerG)
bbox_3 = BoundingBox(Content=arc_2.Arc, Plane=PlaneXY(0, 0, 0))  # -> Box, Box_2
panel_99 = Panel("""0.0
1.0""")
box_corners_3 = BoxCorners(Box=bbox_3.Box)  # -> CornerA, CornerB, CornerC, CornerD, CornerE, CornerF, CornerG, CornerH
panel_100 = Panel([pt_48, pt_49])
panel_101 = Panel([num, pt_48, arc_3.Arc, pt_49])
pt_50 = Point(box_corners_3.CornerA)
pt_51 = Point(box_corners_3.CornerG)
panel_102 = Panel(crv_cp_6.Parameter)
eval_8 = EvaluateCurve(Curve=reparameterize(orient.Geometry), Parameter=panel_99)  # -> Point, Tangent, Angle
panel_103 = Panel([pt_50, pt_51])
panel_104 = Panel(eval_8.Point)
cos = Cosine(Value="0.324263")
sin = Sine(Value="0.324263")
multiplication_3 = Multiplication(A="23", B=cos)
multiplication_4 = Multiplication(A="23", B=sin)
c_script_10 = CSharpScript(S="{ 5, 5, 5 }", E="{ 10, 15, 10 }", D="{ 3, 3, 0 }")  # -> out, A, B, C, P, T; inputs S: Point3d, E: Point3d, D: Vector3d
# ---------- c_script_10: C# ----------
    Vector3d vector3d1 = D;
    Vector3d vector3d2 = E - S;
    vector3d2.Unitize();
    vector3d1.Unitize();
    Vector3d vector3d3 = vector3d2 + vector3d1;
    vector3d3.Unitize();
    Vector3d vector3d4 = vector3d3 * (0.5 * S.DistanceTo(E) / (vector3d3 * vector3d1));
    Arc arc = new Arc(S, S + vector3d4, E);
    Circle c = new Circle(S, S + vector3d4, E);
    B = S + vector3d4;
    A = arc;
    C = c.ToNurbsCurve();
    P = arc.PointAt(4.00);
    T = c.Plane.PointAt(c.Radius, c.Radius);
# ---------- end c_script_10 ----------
arc_4 = ArcSED(Start="{ 5, 5, 5 }", End="{ 10, 15, 10 }", Direction="{ 3, 3, 0 }")  # -> Arc, Plane, Radius
multiplication_5 = Multiplication(A=deplane_7.YAxis, B=multiplication_4)
multiplication_6 = Multiplication(A=deplane_7.XAxis, B=multiplication_3)
pln_2 = Plane(arc_4.Plane)
deplane_9 = DeconstructPlane(Plane=pln_2)  # -> Origin, XAxis, YAxis, ZAxis
addition_2 = Addition(A=multiplication_6, B=multiplication_5)
panel_105 = Panel([deplane_9.XAxis, deplane_9.YAxis, deplane_9.ZAxis])
addition_3 = Addition(A=deplane_7.Origin, B=addition_2)
panel_106 = Panel([multiplication_3, multiplication_4, addition_3])

# ---- group: Arc and Circle / ToNurbs
cp_6 = ControlPoints(Curve=reparameterize(c_script_7.B))  # -> Points, Weights, Knots
yz_3 = YZPlane(Origin=Point(0, 0, 0))
panel_107 = Panel(cp_6.Knots)
c_script_11 = CSharpScript(pl=yz_3)  # -> out, A; inputs pl: Plane
# ---------- c_script_11: C# ----------
    Circle c = new Circle(pl, 20);
    Arc arc = new Arc(c, 1.8);
    A = arc;
# ---------- end c_script_11 ----------
cp_7 = ControlPoints(Curve=reparameterize(c_script_11.A))  # -> Points, Weights, Knots
panel_108 = Panel(cp_7.Weights)

# ----
c_script_12 = CSharpScript(x=arc.Arc, y=panel_94)  # -> out, A, B; inputs y: Double
# ---------- c_script_12: C# ----------
    A = x.TangentAt(y);
    B = x.PointAt(y);
# ---------- end c_script_12 ----------

# ---- group: Arc and Circle (continued)
panel_109 = Panel(c_script_12.A)

# ----
panel_110 = Panel(c_script_12.B)
panel_111 = Panel(arc_4.Arc)

# ---- group: Binomial
number_slider_4 = Slider(6, range=0..10)
number_slider_5 = Slider(2, range=0..10)
c_script_13 = CSharpScript(Kval=number_slider_4, Ival=number_slider_5)  # -> out, A; inputs Kval: Int32, Ival: Int32
# ---------- c_script_13: C# ----------
    double t = Binomial.Get(Kval, Ival);
    A = t;
# ---------- c_script_13: C# additional code ----------
  public class Binomial
  {
    private static Dictionary<int, Tuple<int, double>> _storage = new Dictionary<int, Tuple<int, double>>();

    public static double Get(int n, int k)
    {
      if (k == 0.0) return 1.0;
      if (n == 0 || k > n) return 0.0;
      if (k > n - k) k = n - k;

      if (_storage.ContainsKey(n) && _storage[n].Item1 == k)
        return _storage[n].Item2;

      var r = 1.0;
      var n0 = n;

      for (int d = 1; d < k + 1; d++)
      {
        if (_storage.ContainsKey(n0) && _storage[n0].Item1 == d)
        {
          n--;
          r = _storage[n0].Item2;
          continue;
        }

        r *= n--;
        r /= d;

        if(!_storage.ContainsKey(n0))
        {
          Tuple<int, double> temp = new Tuple<int, double>(d, r);
          _storage.Remove(n0);
          _storage.Add(n0, temp);
        }
      }

      return r;
    }
  }
# ---------- end c_script_13 ----------
python_4 = GhPythonScript(Kval=number_slider_4, Ival=number_slider_5)  # -> out, a; inputs Kval: Int32, Ival: Int32
# ---------- python_4: Python ----------
__author__ = "m.bianchini"
__version__ = "2021.01.18"

import rhinoscriptsyntax as rs
import math

def binomial_coefficient(k, i):
    """ Computes the binomial coefficient (denoted by *k choose i*).
    Please see the following website for details: http://mathworld.wolfram.com/BinomialCoefficient.html
    :param k: size of the set of distinct elements
    :type k: int
    :param i: size of the subsets
    :type i: int
    :return: combination of *k* and *i*
    :rtype: float
    """
    # Special case
    if i > k:
        return float(0)
    # Compute binomial coefficient
    k_fact = math.factorial(k)
    i_fact = math.factorial(i)
    k_i_fact = math.factorial(k - i)
    return float(k_fact / (k_i_fact * i_fact))

a = binomial_coefficient(Kval, Ival)
# ---------- end python_4 ----------
panel_112 = Panel(python_4.a)

# ----
c_script_14 = CSharpScript(K=number_slider_5, I=number_slider_4)  # -> out, A; inputs K: Int32, I: Int32
# ---------- c_script_14: C# ----------
    A = BinomialCoefficient(I, K);
# ---------- c_script_14: C# additional code ----------
  public double BinomialCoefficient(int n, int i)
  {
    return Factorial(n) / (Factorial(i) * Factorial(n - i));
  }

  private int Factorial(int n)
  {
    if (n == 0)
    {
      return 1;
    }

    var fact = n;
    for (var i = n - 1; i >= 1; i--)
    {
      fact *= i;
    }
    return fact;
  }
# ---------- end c_script_14 ----------

# ---- group: Binomial (continued)
panel_113 = Panel([c_script_13.A, c_script_14.A])

# ----
panel_114 = Panel("{0,10,0}")
panel_115 = Panel("{10,0,0}")
ln_8 = Line(StartPoint="{0,0,0}", EndPoint="{5,5,10}")
xy_2 = XYPlane(Origin=Point(0, 0, 0))
yz_4 = YZPlane(Origin="{10,20,5}")
xz = XZPlane(Origin="{10,-10,-5}")
ppx = PlanePlane(PlaneA=yz_4, PlaneB=xz)
ppx_2 = PlanePlane(PlaneA=xy_2, PlaneB=yz_4)
plx = LinePlane(Line=ln_8, Plane=yz_4)  # -> Point, ParamL, ParamP
curvepoint = PointOnCurve(ppx_2, parameter=0)
vec_3 = Vector(ppx_2)
curvepoint_2 = PointOnCurve(ppx, parameter=0)
vec_4 = Vector(ppx)
panel_116 = Panel([curvepoint, vec_3])
panel_117 = Panel([curvepoint_2, vec_4])

# ---- group: Plane_Equation_ValueAt
c_script_15 = CSharpScript(pl=yz_4, pt="{20,20,10}")  # -> out, A; inputs pl: Plane, pt: Point3d
# ---------- c_script_15: C# ----------
    double[] d = pl.GetPlaneEquation();
    A = d;
# ---------- end c_script_15 ----------
item_3 = ListItem(List=c_script_15.A, Index=0, Wrap=True)  # -> Item, Item1, Item2, Item3
pdecon = Deconstruct(Point="{0,0,0}")  # -> XComponent, YComponent, ZComponent
multiplication_7 = Multiplication(A=pdecon.YComponent, B=item_3.Item1)
multiplication_8 = Multiplication(A=pdecon.ZComponent, B=item_3.Item2)
multiplication_9 = Multiplication(A=pdecon.XComponent, B=item_3.Item)
addition_4 = Addition(A=multiplication_9, B=multiplication_7, C=multiplication_8, D=item_3.Item3)

# ---- group: LineCircle
ln_9 = Line(StartPoint="{10,29.769674,17.028815}", EndPoint="{10,37.594559,24.680781}")
ln_10 = Line(StartPoint="{-15,45,17}", EndPoint="{15,45,25}")
ln_11 = Line(StartPoint="{10,40,25}", EndPoint="{10,40,15}")
c_script_16 = CSharpScript(pl=yz_4, ln=ln_11)  # -> out, A; inputs pl: Plane, ln: Line
# ---------- c_script_16: C# ----------
    Circle c = new Circle(pl, 20);
    double t1, t2;
    Point3d point1, point2;
    var i = Rhino.Geometry.Intersect.Intersection.LineCircle(ln, c, out t1, out point1, out t2, out point2);
    A = new Point3d[]{point1, point2};
# ---------- end c_script_16 ----------

# ---- group: PolylinePlane
crv = Curve(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)
pcx_3 = CurvePlane(Curve=crv, Plane=yz_4)  # -> Points, ParamsC, ParamsP

# ---- group: PlaneCircle
pt_52 = Point(Point(10, 10, 10))
pt_53 = Point(Point(10, 20, 25))
pl_3 = PlaneNormal(Origin=pt_52, ZAxis=pt_53)
c_script_17 = CSharpScript(pl=yz_4, plS=pl_3)  # -> out, A, B; inputs pl: Plane, plS: Plane
# ---------- c_script_17: C# ----------
    Circle c = new Circle(pl, 20);
    double t1, t2;
    Point3d point1, point2;
    var i = Rhino.Geometry.Intersect.Intersection.PlaneCircle(plS, c, out t1, out t2);
    point1 = c.PointAt(t1);
    point2 = c.PointAt(t2);
    A = new Point3d[]{point1, point2};
    B = c;
# ---------- end c_script_17 ----------

# ----
panel_118 = Panel(c_script_16.A)

# ---- group: VectorRotation / RodrigoFormula
panel_119 = Panel("""-0.00000125
0.0
12.5
450""")
rad_3 = Radians(Degrees=panel_119)
cos_2 = Cosine(Value=rad_3)
sin_2 = Sine(Value=rad_3)
subtraction_4 = Subtraction(A=1, B=cos_2)

# ---- group: VectorRotation
pt_54 = ConstructPoint(XCoordinate="-7", YCoordinate="10", ZCoordinate="-5")
pt_55 = ConstructPoint(XCoordinate=0, YCoordinate=0, ZCoordinate=0)
c_script_18 = CSharpScript(pt=pt_55, Dir=pt_54)  # -> out, A; inputs pt: Point3d, Dir: Vector3d
# ---------- c_script_18: C# ----------
    Ray3d r = new Ray3d(pt, Dir);

    var yAxis = Vector3d.YAxis;
    yAxis.PerpendicularTo(r.Direction);
    A = yAxis;
# ---------- end c_script_18 ----------
unit_2 = UnitVector(Vector=c_script_18.A)
vdis_5 = VectorDisplay(Anchor=pt_55, Vector=c_script_18.A)
vdis_6 = VectorDisplay(Anchor=pt_55, Vector=pt_54)
vrot = Rotate(Vector=pt_54, Axis=unit_2, Angle=rad_3)
panel_120 = Panel(vrot)

# ---- group: VectorRotation / RodrigoFormula (continued)
xprod_2 = CrossProduct(VectorA=unit_2, VectorB=pt_54, Unitize=False)  # -> Vector, Length
dprod_2 = DotProduct(VectorA=unit_2, VectorB=pt_54, Unitize=False)
multiplication_10 = Multiplication(A=unit_2, B=dprod_2)
multiplication_11 = Multiplication(A=sin_2, B=xprod_2.Vector)
multiplication_12 = Multiplication(A=pt_54, B=cos_2)
multiplication_13 = Multiplication(A=subtraction_4, B=multiplication_10)
addition_5 = Addition(A=multiplication_12, B=multiplication_11, C=multiplication_13)

# ---- group: VectorRotation (continued)
panel_121 = Panel(addition_5)
vdis_7 = VectorDisplay(Anchor=pt_55, Vector=[vrot, addition_5])
