# Grasshopper definition GH.gh (Grasshopper 1.0.7)

number_slider = Slider(0.5, range=0..1)
pt = Point(<point referenced from the Rhino model>)
pt_2 = Point(<point referenced from the Rhino model>)
pt_3 = Point(<point referenced from the Rhino model>)
pt_4 = Point(<point referenced from the Rhino model>)
pt_5 = Point(Point(30, -20, 0))
pt_6 = Point(Point(20, -20, 0))
pt_7 = Point(Point(10, -10, 10))
pt_8 = Point(Point(20, -10, 0))
pt_9 = Point(Point(30, -10, 0))
pt_10 = Point(Point(0, 0, 0))
pt_11 = Point(Point(10, -20, 0))
pt_12 = Point(Point(0, -10, 0))
pt_13 = Point(Point(0, -30, 0))
pt_14 = Point(Point(20, 0, 0))
pt_15 = Point(Point(30, 0, 0))
pt_16 = Point(Point(10, 0, 0))
pt_17 = Point(Point(0, -20, 0))
pt_18 = Point(Point(10, -30, 0))
pt_19 = Point(Point(20, -30, 0))
pt_20 = Point(Point(30, -30, 0))
srf4pt = _4PointSurface(CornerA=pt, CornerB=pt_2, CornerC=pt_4, CornerD=pt_3)
pt_21 = ConstructPoint(XCoordinate=number_slider, YCoordinate=number_slider, ZCoordinate=0)
panel = Panel([pt_17, pt_11, pt_6, pt_5])
panel_2 = Panel([pt_13, pt_18, pt_19, pt_20])
evalsrf = EvaluateSurface(Surface=reparameterize(srf4pt), Point=pt_21)  # -> Point, Normal, UDirection, VDirection, Frame
panel_3 = Panel([pt_12, pt_7, pt_8, pt_9])
panel_4 = Panel([pt_10, pt_16, pt_14, pt_15])
panel_5 = Panel(evalsrf.Point)
iso = IsoCurve(Surface=reparameterize(srf4pt), UVPoint=pt_21)  # -> UIsocurve, VIsocurve
number_slider_2 = Slider(0.5, range=0..1)
srfgrid = SurfaceFromPoints(Points=[panel_4, panel_3, panel, panel_2], UCount="4", Interpolate=False)
pt_22 = ConstructPoint(XCoordinate="0.2", YCoordinate="0.2", ZCoordinate=0)
pt_23 = ConstructPoint(XCoordinate=number_slider_2, YCoordinate=number_slider_2, ZCoordinate=0)
evalsrf_2 = EvaluateSurface(Surface=srfgrid, Point=pt_23)  # -> Point, Normal, UDirection, VDirection, Frame
crv = Curve(<curve referenced from the Rhino model>)
iso_2 = IsoCurve(Surface=reparameterize(srfgrid), UVPoint=pt_22)  # -> UIsocurve, VIsocurve
cp = ControlPoints(Curve=reparameterize(crv))  # -> Points, Weights, Knots
panel_6 = Panel(evalsrf_2.Point)
eval = EvaluateCurve(Curve=iso_2.UIsocurve, Parameter=number_slider_2)  # -> Point, Tangent, Angle
panel_7 = Panel(cp.Points)
panel_8 = Panel(eval.Point)
