# Dynamo graph SurfaceDebug.dyn (Dynamo 2.10.0.3455)

code_block = CodeBlock { Point.ByCoordinates(0,0,50); Point.ByCoordinates(10,0,0); Point.ByCoordinates(20,0,0); Point.ByCoordinates(30,0,0); }
list_create = List.Create(item0=code_block.out0, item1=code_block.out1, item2=code_block.out2, item3=code_block.out3)
code_block_2 = CodeBlock()
# ---------- code_block_2.designscript (4 lines) ----------
Point.ByCoordinates(0,-10,0);
Point.ByCoordinates(10,-10,10);
Point.ByCoordinates(20,-10,10);
Point.ByCoordinates(30,-10,0);
# ----------------------------------------
list_create_2 = List.Create(item0=code_block_2.out0, item1=code_block_2.out1, item2=code_block_2.out2, item3=code_block_2.out3)
code_block_3 = CodeBlock()
# ---------- code_block_3.designscript (4 lines) ----------
Point.ByCoordinates(0,-20,0);
Point.ByCoordinates(10,-20,10);
Point.ByCoordinates(20,-20,10);
Point.ByCoordinates(30,-20,0);
# ----------------------------------------
list_create_3 = List.Create(item0=code_block_3.out0, item1=code_block_3.out1, item2=code_block_3.out2, item3=code_block_3.out3)
code_block_4 = CodeBlock()
# ---------- code_block_4.designscript (4 lines) ----------
Point.ByCoordinates(0,-30,0);
Point.ByCoordinates(10,-30,0);
Point.ByCoordinates(20,-30,0);
Point.ByCoordinates(30,-30,0);
# ----------------------------------------
list_create_4 = List.Create(item0=code_block_4.out0, item1=code_block_4.out1, item2=code_block_4.out2, item3=code_block_4.out3)
list_create_5 = List.Create(item0=list_create, item1=list_create_2, item2=list_create_3, item3=list_create_4)
byControlPoints = NurbsSurface.ByControlPoints(controlVertices=list_create_5)
code_block_5 = CodeBlock { 0.5; }
pointAtParameter = Surface.PointAtParameter(surface=byControlPoints, u=code_block_5, v=code_block_5)
code_block_6 = CodeBlock()
# ---------- code_block_6.designscript (4 lines) ----------
Point.ByCoordinates(6.292,-3.297,-1.311);
Point.ByCoordinates(4.599,4.910,5.869);
Point.ByCoordinates(-8.032,-8.329,-0.556);
Point.ByCoordinates(-7.966,7.580,5.366);
# ----------------------------------------
list_create_6 = List.Create(item0=code_block_6.out0, item1=code_block_6.out1, item2=code_block_6.out2, item3=code_block_6.out3)
code_block_7 = CodeBlock { [1,1,1,1]; }
code_block_8 = CodeBlock { [0,0,1,1]; }
code_block_9 = CodeBlock { 1; }
byControlPointsWeightsKnots = NurbsSurface.ByControlPointsWeightsKnots(controlVertices=list_create_6, weights=code_block_7, knotsU=code_block_8, knotsV=code_block_8, uDegree=code_block_9, vDegree=code_block_9)
code_block_10 = CodeBlock { 0.5; }
pointAtParameter_2 = Surface.PointAtParameter(surface=byControlPointsWeightsKnots, u=code_block_10, v=code_block_10)
