# Dynamo graph DynamoDebug.dyn (Dynamo 2.5.0.7460)

code_block = CodeBlock()
# ---------- code_block.designscript (4 lines) ----------
Point.ByCoordinates(6.292,-3.297,-1.311);
Point.ByCoordinates(4.599,4.910,5.869);
Point.ByCoordinates(-8.032,-8.329,-0.556);
Point.ByCoordinates(-7.966,7.580,5.366);
# ----------------------------------------
list_create = List.Create(item0=code_block.out0, item1=code_block.out1, item2=code_block.out2, item3=code_block.out3)
code_block_2 = CodeBlock { [1,1,1,1]; }
code_block_3 = CodeBlock { [0,0,1,1]; }
code_block_4 = CodeBlock { 1; }
byControlPointsWeightsKnots = NurbsSurface.ByControlPointsWeightsKnots(controlVertices=list_create, weights=code_block_2, knotsU=code_block_3, knotsV=code_block_3, uDegree=code_block_4, vDegree=code_block_4)
code_block_5 = CodeBlock { 0.5; }
pointAtParameter = Surface.PointAtParameter(surface=byControlPointsWeightsKnots, u=code_block_5, v=code_block_5)
code_block_6 = CodeBlock { Point.ByCoordinates(0,0,0); Point.ByCoordinates(10,0,0); Point.ByCoordinates(20,0,0); Point.ByCoordinates(30,0,0); }
list_create_2 = List.Create(item0=code_block_6.out0, item1=code_block_6.out1, item2=code_block_6.out2, item3=code_block_6.out3)
code_block_7 = CodeBlock()
# ---------- code_block_7.designscript (4 lines) ----------
Point.ByCoordinates(0,-10,0);
Point.ByCoordinates(10,-10,10);
Point.ByCoordinates(20,-10,0);
Point.ByCoordinates(30,-10,0);
# ----------------------------------------
list_create_3 = List.Create(item0=code_block_7.out0, item1=code_block_7.out1, item2=code_block_7.out2, item3=code_block_7.out3)
code_block_8 = CodeBlock()
# ---------- code_block_8.designscript (4 lines) ----------
Point.ByCoordinates(0,-20,0);
Point.ByCoordinates(10,-20,0);
Point.ByCoordinates(20,-20,0);
Point.ByCoordinates(30,-20,0);
# ----------------------------------------
list_create_4 = List.Create(item0=code_block_8.out0, item1=code_block_8.out1, item2=code_block_8.out2, item3=code_block_8.out3)
code_block_9 = CodeBlock()
# ---------- code_block_9.designscript (4 lines) ----------
Point.ByCoordinates(0,-30,0);
Point.ByCoordinates(10,-30,0);
Point.ByCoordinates(20,-30,0);
Point.ByCoordinates(30,-30,0);
# ----------------------------------------
list_create_5 = List.Create(item0=code_block_9.out0, item1=code_block_9.out1, item2=code_block_9.out2, item3=code_block_9.out3)
list_create_6 = List.Create(item0=list_create_2, item1=list_create_3, item2=list_create_4, item3=list_create_5)
byControlPoints = NurbsSurface.ByControlPoints(controlVertices=list_create_6)
controlPoints = NurbsSurface.ControlPoints(nurbsSurface=byControlPoints)
code_block_10 = CodeBlock { 0; 1; }
V = DoubleSlider(0.7, range=0..1 step 0.001)
byIsoCurveOnSurface = Curve.ByIsoCurveOnSurface(baseSurface=byControlPoints, direction=code_block_10.out0, parameter=V)
U = DoubleSlider(0.2, range=0..1 step 0.001)
byIsoCurveOnSurface_2 = Curve.ByIsoCurveOnSurface(baseSurface=byControlPoints, direction=code_block_10.out1, parameter=U)
code_block_11 = CodeBlock { [0.5,0.2]; [0.5,0.7]; }
pointAtParameter_2 = Surface.PointAtParameter(surface=byControlPoints, u=code_block_11.out0, v=code_block_11.out1)
normalAtParameter = Surface.NormalAtParameter(surface=byControlPoints, u=code_block_11.out0, v=code_block_11.out1)
code_block_12 = CodeBlock { 5; }
byStartPointDirectionLength = Line.ByStartPointDirectionLength(startPoint=pointAtParameter_2, direction=normalAtParameter, length=code_block_12)
watch = Watch(normalAtParameter)
tangentAtUParameter = Surface.TangentAtUParameter(surface=byControlPoints, u=code_block_11.out0, v=code_block_11.out1)
byStartPointDirectionLength_2 = Line.ByStartPointDirectionLength(startPoint=pointAtParameter_2, direction=tangentAtUParameter, length=code_block_12)
tangentAtVParameter = Surface.TangentAtVParameter(surface=byControlPoints, u=code_block_11.out0, v=code_block_11.out1)
byStartPointDirectionLength_3 = Line.ByStartPointDirectionLength(startPoint=pointAtParameter_2, direction=tangentAtVParameter, length=code_block_12)
code_block_13 = CodeBlock { Point.ByCoordinates(-20,0,0); Point.ByCoordinates(0,0,10); Point.ByCoordinates(10,0,0); }
list_create_7 = List.Create(item0=code_block_13.out0, item1=code_block_13.out1, item2=code_block_13.out2)
code_block_14 = CodeBlock { Point.ByCoordinates(-15,10,0); Point.ByCoordinates(0,10,5); Point.ByCoordinates(20,10,1); }
list_create_8 = List.Create(item0=code_block_14.out0, item1=code_block_14.out1, item2=code_block_14.out2)
code_block_15 = CodeBlock { Point.ByCoordinates(-5,25,0); Point.ByCoordinates(0,25,20); Point.ByCoordinates(10,25,0); }
list_create_9 = List.Create(item0=code_block_15.out0, item1=code_block_15.out1, item2=code_block_15.out2)
code_block_16 = CodeBlock { Point.ByCoordinates(-5,35,-2); Point.ByCoordinates(0,35,20); Point.ByCoordinates(5,35,0); }
list_create_10 = List.Create(item0=code_block_16.out0, item1=code_block_16.out1, item2=code_block_16.out2)
list_create_11 = List.Create(item0=list_create_7, item1=list_create_8, item2=list_create_9, item3=list_create_10)
code_block_17 = CodeBlock { 2; }
boolean = BoolSelector(true)
byControlPoints_2 = NurbsCurve.ByControlPoints(points=list_create_11, degree=code_block_17, closeCurve=boolean)
transpose = List.Transpose(lists=list_create_11)

# group: Loose_Lofted_Surface_By_Opened_Curves
code_block_18 = CodeBlock { 2; 3; }
byControlPoints_3 = NurbsSurface.ByControlPoints(controlVertices=transpose@L3, uDegree=code_block_18.out0, vDegree=code_block_18.out1)

# group: Normal_Lofted_Surface_By_Open_Curves
code_block_19 = CodeBlock { 3; }
byPoints = NurbsCurve.ByPoints(points=transpose, degree=code_block_19)
controlPoints_2 = NurbsCurve.ControlPoints(nurbsCurve=byPoints)
code_block_20 = CodeBlock { 2; 3; }
byControlPoints_4 = NurbsSurface.ByControlPoints(controlVertices=controlPoints_2@L3, uDegree=code_block_20.out0, vDegree=code_block_20.out1)

number_slider = DoubleSlider(0.1, range=0..1 step 0.1)
number_slider_2 = DoubleSlider(0.1, range=0..1 step 0.1)
pointAtParameter_3 = Surface.PointAtParameter(surface=byControlPoints_4, u=number_slider, v=number_slider_2)
code_block_21 = CodeBlock(pt=pointAtParameter_3) { x = pt.X; y = pt.Y; z = pt.Z; }
watch_2 = Watch(code_block_21.x)
watch_3 = Watch(code_block_21.y)
watch_4 = Watch(code_block_21.z)
