# Grasshopper definition GHDebugLoftedSurface.gh (Grasshopper 1.0.7)

# NURBS Surface_ All closed curves
number_slider = Slider(2, range=0..10)
# NURBS Surface_ All opened curves
number_slider_2 = Slider(2, range=0..10)
panel = Panel("""{-15.0, 10.0, 0.0}
{0.0, 10.0, 5.0}
{20.0, 10.0, 1.0}""")
panel_2 = Panel("""{-5.0, 25.0, 0.0}
{0.0, 25.0, 20.0}
{10.0, 25.0, 0.0}""")
panel_3 = Panel("""{-20.0, 0.0, 0.0}
{0.0, 0.0, 10.0}
{10.0, 0.0, 0.0}""")
panel_4 = Panel("""{-5.0, 35.0, -2.0}
{0.0, 35.0, 20.0}
{5.0, 35.0, 0.0}""")
panel_5 = Panel("""{-5.0, 25.0, 0.0}
{0.0, 25.0, 20.0}
{10.0, 25.0, 0.0}
{-5.0, 25.0, 0.0}""")
panel_6 = Panel("""{-20.0, 0.0, 0.0}
{0.0, 0.0, 10.0}
{10.0, 0.0, 0.0}
{-20.0, 0.0, 0.0}""")
panel_7 = Panel("""{-15.0, 10.0, 0.0}
{0.0, 10.0, 5.0}
{20.0, 10.0, 1.0}
{-15.0, 10.0, 0.0}""")
panel_8 = Panel("""{-5.0, 35.0, -2.0}
{0.0, 35.0, 20.0}
{5.0, 35.0, 0.0}
{-5.0, 35.0, -2.0}""")
loft_opt = LoftOptions(Closed=False, Adjust=False, Rebuild=0, Refit=0, Type=Slider(1, range=0..10))
loft_opt_2 = LoftOptions(Closed=False, Adjust=False, Rebuild=0, Refit=0, Type=Slider(1, range=0..10))
nurbs = NurbsCurve(Vertices=panel_3, Degree=number_slider, Periodic=False)  # -> Curve, Length, Domain
nurbs_2 = NurbsCurve(Vertices=panel, Degree=number_slider, Periodic=False)  # -> Curve, Length, Domain
nurbs_3 = NurbsCurve(Vertices=panel_2, Degree=number_slider, Periodic=False)  # -> Curve, Length, Domain
nurbs_4 = NurbsCurve(Vertices=panel_4, Degree=number_slider, Periodic=False)  # -> Curve, Length, Domain
nurbs_5 = NurbsCurve(Vertices=panel_6, Degree=number_slider_2, Periodic=False)  # -> Curve, Length, Domain
nurbs_6 = NurbsCurve(Vertices=panel_7, Degree=number_slider_2, Periodic=False)  # -> Curve, Length, Domain
nurbs_7 = NurbsCurve(Vertices=panel_5, Degree=number_slider_2, Periodic=False)  # -> Curve, Length, Domain
nurbs_8 = NurbsCurve(Vertices=panel_8, Degree=number_slider_2, Periodic=False)  # -> Curve, Length, Domain
merge = Merge(Data1=nurbs.Curve, Data2=nurbs_2.Curve, Data3=nurbs_3.Curve, Data4=nurbs_4.Curve)
merge_2 = Merge(Data1=nurbs_5.Curve, Data2=nurbs_6.Curve, Data3=nurbs_7.Curve, Data4=nurbs_8.Curve)
panel_9 = Panel("""{0.5,0.5,0.0}
{0.1,0.1,0.0}
{1.0,1.0,0.0}""")
panel_10 = Panel("""{0.5,0.5,0.0}
{0.1,0.1,0.0}
{1.0,1.0,0.0}""")
loft = Loft(Curves=merge, Options=loft_opt_2)
loft_2 = Loft(Curves=merge_2, Options=loft_opt)
evalsrf = EvaluateSurface(Surface=reparameterize(loft), Point=panel_9)  # -> Point, Normal, UDirection, VDirection, Frame
evalsrf_2 = EvaluateSurface(Surface=reparameterize(loft_2), Point=panel_10)  # -> Point, Normal, UDirection, VDirection, Frame
srfpt = SurfacePoints(Surface=loft)  # -> Points, Weights, Greville, UCount, VCount
srfpt_2 = SurfacePoints(Surface=loft_2)  # -> Points, Weights, Greville, UCount, VCount
panel_11 = Panel(evalsrf.VDirection)
panel_12 = Panel([srfpt.VCount, srfpt.UCount])
panel_13 = Panel(evalsrf.Point)
panel_14 = Panel(evalsrf_2.VDirection)
panel_15 = Panel([srfpt_2.VCount, srfpt_2.UCount])
panel_16 = Panel(evalsrf_2.Point)
item = ListItem(List=panel_13, Index=Slider(3, range=0..10), Wrap=True)
item_2 = ListItem(List=panel_16, Index=Slider(2, range=0..10), Wrap=True)
panel_17 = Panel(item)
panel_18 = Panel(item_2)
