# Grasshopper definition GHDebugSurface.gh (Grasshopper 1.0.7)

# ---- group: SurfaceFromAGridOfPoints
srf = Surface(reparameterize(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))  # disabled
srfpt = SurfacePoints(Surface=srf)  # -> Points, Weights, Greville, UCount, VCount; disabled

# ----
# NURBS Surface_Normal_Lofted surface_ All opened curves
number_slider = Slider(2, range=0..10)
panel = Panel("""{-20.0, 0.0, 0.0}
{0.0, 0.0, 10.0}
{10.0, 0.0, 0.0}""")
panel_2 = Panel("""{-15.0, 10.0, 0.0}
{0.0, 10.0, 5.0}
{20.0, 10.0, 1.0}""")
panel_3 = Panel("""{-5.0, 25.0, 0.0}
{0.0, 25.0, 20.0}
{10.0, 25.0, 0.0}""")
panel_4 = Panel("""{-5.0, 35.0, -2.0}
{0.0, 35.0, 20.0}
{5.0, 35.0, 0.0}""")
loft_opt = LoftOptions(Closed=False, Adjust=False, Rebuild=0, Refit=0, Type=Slider(0, range=0..10))
nurbs = NurbsCurve(Vertices=panel, Degree=number_slider, Periodic=False)  # -> Curve, Length, Domain
nurbs_2 = NurbsCurve(Vertices=panel_2, Degree=number_slider, Periodic=False)  # -> Curve, Length, Domain
nurbs_3 = NurbsCurve(Vertices=panel_3, Degree=number_slider, Periodic=False)  # -> Curve, Length, Domain
nurbs_4 = NurbsCurve(Vertices=panel_4, Degree=number_slider, Periodic=False)  # -> Curve, Length, Domain
merge = Merge(Data1=nurbs.Curve, Data2=nurbs_2.Curve, Data3=nurbs_3.Curve, Data4=nurbs_4.Curve)
panel_5 = Panel("""{0.5,0.5,0.0}
{0.1,0.1,0.0}
{1.0,1.0,0.0}""")
loft = Loft(Curves=merge, Options=loft_opt)
evalsrf = EvaluateSurface(Surface=reparameterize(loft), Point=panel_5)  # -> Point, Normal, UDirection, VDirection, Frame
srfpt_2 = SurfacePoints(Surface=loft)  # -> Points, Weights, Greville, UCount, VCount
panel_6 = Panel([srfpt_2.VCount, srfpt_2.UCount])
panel_7 = Panel(evalsrf.Point)
item = ListItem(List=panel_7, Index=Slider(2, range=0..10), Wrap=True)
panel_8 = Panel(item)

# ----
# NURBS Surface_ Lofted surface_All closed curves
number_slider_2 = Slider(2, range=0..10)
panel_9 = Panel("""{-20.0, 0.0, 0.0}
{0.0, 0.0, 10.0}
{10.0, 0.0, 0.0}""")
panel_10 = Panel("""{-15.0, 10.0, 0.0}
{0.0, 10.0, 5.0}
{20.0, 10.0, 1.0}""")
panel_11 = Panel("""{-5.0, 25.0, 0.0}
{0.0, 25.0, 20.0}
{10.0, 25.0, 0.0}""")
panel_12 = Panel("""{-5.0, 35.0, -2.0}
{0.0, 35.0, 20.0}
{5.0, 35.0, 0.0}""")

# ---- group: SurfaceFrom4Points
panel_13 = Panel("{10.0, 0.0, 0.0}")  # disabled
panel_14 = Panel("{0.0, 10.0, 4.0}")  # disabled
# All these definitions were used to convalidate and developed the GeometrySharp surfaces tests.
panel_15 = Panel("{0.0, 0.0, 0.0}")  # disabled
panel_16 = Panel("{10.0, 10.0, 2.0}")  # disabled
srf4pt = _4PointSurface(CornerA=panel_15, CornerB=panel_13, CornerC=panel_16, CornerD=panel_14)  # -> reparameterize(Surface); disabled

# ----
panel_17 = Panel(srfpt.Weights)  # disabled
panel_18 = Panel(srfpt.Points)  # disabled
loft_opt_2 = LoftOptions(Closed=False, Adjust=False, Rebuild=0, Refit=0, Type=Slider(0, range=0..10))
nurbs_5 = NurbsCurve(Vertices=panel_9, Degree=number_slider_2, Periodic="1")  # -> Curve, Length, Domain
nurbs_6 = NurbsCurve(Vertices=panel_10, Degree=number_slider_2, Periodic="1")  # -> Curve, Length, Domain
nurbs_7 = NurbsCurve(Vertices=panel_11, Degree=number_slider_2, Periodic="1")  # -> Curve, Length, Domain
nurbs_8 = NurbsCurve(Vertices=panel_12, Degree=number_slider_2, Periodic="1")  # -> Curve, Length, Domain
merge_2 = Merge(Data1=nurbs_5.Curve, Data2=nurbs_6.Curve, Data3=nurbs_7.Curve, Data4=nurbs_8.Curve)
panel_19 = Panel("""{0.1,0.1,0.0}
{0.5,0.5,0.0}
{1.0,1.0,0.0}""")
loft_2 = Loft(Curves=merge_2, Options=loft_opt_2)

# ---- group: PointAt and VectorAt
panel_20 = Panel("""{0.5,0.5,0.0}
{0.1,0.1,0.0}
{1,1,0.0}
{0.3,0.5,0.0}""")  # disabled
evalsrf_2 = EvaluateSurface(Surface=srf, Point=panel_20)  # -> Point, Normal, UDirection, VDirection, Frame; disabled
panel_21 = Panel(evalsrf_2.VDirection)  # disabled
panel_22 = Panel(evalsrf_2.Point)  # disabled

# ---- group: RationalDerivatives
c_script = CSharpScript(srf=srf)  # -> out, derv0, dervs; inputs srf: Surface; disabled
# ---------- c_script: C# ----------
    Point3d pt;
    Vector3d[] derivis;
    srf.Evaluate(0.3, 0.5, 1, out pt, out derivis);
    dervs = derivis;
    derv0 = pt;
# ---------- end c_script ----------
panel_23 = Panel(c_script.derv0)  # disabled
panel_24 = Panel(c_script.dervs)  # disabled

# ----
evalsrf_3 = EvaluateSurface(Surface=reparameterize(loft_2), Point=panel_19)  # -> Point, Normal, UDirection, VDirection, Frame
srfpt_3 = SurfacePoints(Surface=loft_2)  # -> Points, Weights, Greville, UCount, VCount
panel_25 = Panel(evalsrf_3.VDirection)
panel_26 = Panel([srfpt_3.VCount, srfpt_3.UCount])
panel_27 = Panel(evalsrf_3.Point)
item_2 = ListItem(List=panel_27, Index=Slider(2, range=0..2), Wrap=True)
panel_28 = Panel(item_2)

# ----
# NURBS Surface_Loose_Lofted surface_ All opened curves
number_slider_3 = Slider(2, range=0..10)
panel_29 = Panel("""{-5.0, 25.0, 0.0}
{0.0, 25.0, 20.0}
{10.0, 25.0, 0.0}""")
panel_30 = Panel("""{-20.0, 0.0, 0.0}
{0.0, 0.0, 10.0}
{10.0, 0.0, 0.0}""")
panel_31 = Panel("""{-15.0, 10.0, 0.0}
{0.0, 10.0, 5.0}
{20.0, 10.0, 1.0}""")
panel_32 = Panel("""{-5.0, 35.0, -2.0}
{0.0, 35.0, 20.0}
{5.0, 35.0, 0.0}""")
loft_opt_3 = LoftOptions(Closed=False, Adjust=False, Rebuild=0, Refit=0, Type=Slider(1, range=0..10))
nurbs_9 = NurbsCurve(Vertices=panel_30, Degree=number_slider_3, Periodic=False)  # -> Curve, Length, Domain
nurbs_10 = NurbsCurve(Vertices=panel_31, Degree=number_slider_3, Periodic=False)  # -> Curve, Length, Domain
nurbs_11 = NurbsCurve(Vertices=panel_29, Degree=number_slider_3, Periodic=False)  # -> Curve, Length, Domain
nurbs_12 = NurbsCurve(Vertices=panel_32, Degree=number_slider_3, Periodic=False)  # -> Curve, Length, Domain
merge_3 = Merge(Data1=nurbs_9.Curve, Data2=nurbs_10.Curve, Data3=nurbs_11.Curve, Data4=nurbs_12.Curve)
panel_33 = Panel("""{0.5,0.5,0.0}
{0.1,0.1,0.0}
{1.0,1.0,0.0}""")
loft_3 = Loft(Curves=merge_3, Options=loft_opt_3)
evalsrf_4 = EvaluateSurface(Surface=reparameterize(loft_3), Point=panel_33)  # -> Point, Normal, UDirection, VDirection, Frame
srfpt_4 = SurfacePoints(Surface=loft_3)  # -> Points, Weights, Greville, UCount, VCount
panel_34 = Panel(evalsrf_4.VDirection)
panel_35 = Panel([srfpt_4.VCount, srfpt_4.UCount])
panel_36 = Panel(evalsrf_4.Point)
item_3 = ListItem(List=panel_36, Index=Slider(3, range=0..10), Wrap=True)
panel_37 = Panel(item_3)

# ----
# NURBS Surface_Tight_Lofted surface_ All opened curves
number_slider_4 = Slider(2, range=0..10)
panel_38 = Panel("""{-5.0, 25.0, 0.0}
{0.0, 25.0, 20.0}
{10.0, 25.0, 0.0}""")
panel_39 = Panel("""{-20.0, 0.0, 0.0}
{0.0, 0.0, 10.0}
{10.0, 0.0, 0.0}""")
panel_40 = Panel("""{-15.0, 10.0, 0.0}
{0.0, 10.0, 5.0}
{20.0, 10.0, 1.0}""")
panel_41 = Panel("""{-5.0, 35.0, -2.0}
{0.0, 35.0, 20.0}
{5.0, 35.0, 0.0}""")
loft_opt_4 = LoftOptions(Closed=False, Adjust=False, Rebuild=0, Refit=0, Type=Slider(2, range=0..10))
nurbs_13 = NurbsCurve(Vertices=panel_39, Degree=number_slider_4, Periodic=False)  # -> Curve, Length, Domain
nurbs_14 = NurbsCurve(Vertices=panel_40, Degree=number_slider_4, Periodic=False)  # -> Curve, Length, Domain
nurbs_15 = NurbsCurve(Vertices=panel_38, Degree=number_slider_4, Periodic=False)  # -> Curve, Length, Domain
nurbs_16 = NurbsCurve(Vertices=panel_41, Degree=number_slider_4, Periodic=False)  # -> Curve, Length, Domain
merge_4 = Merge(Data1=nurbs_13.Curve, Data2=nurbs_14.Curve, Data3=nurbs_15.Curve, Data4=nurbs_16.Curve)
panel_42 = Panel("""{0.5,0.5,0.0}
{0.1,0.1,0.0}
{1.0,1.0,0.0}""")
loft_4 = Loft(Curves=merge_4, Options=loft_opt_4)
evalsrf_5 = EvaluateSurface(Surface=reparameterize(loft_4), Point=panel_42)  # -> Point, Normal, UDirection, VDirection, Frame
srfpt_5 = SurfacePoints(Surface=loft_4)  # -> Points, Weights, Greville, UCount, VCount
panel_43 = Panel(evalsrf_5.VDirection)
panel_44 = Panel([srfpt_5.VCount, srfpt_5.UCount])
panel_45 = Panel(evalsrf_5.Point)
item_4 = ListItem(List=panel_45, Index=Slider(3, range=0..10), Wrap=True)
panel_46 = Panel(item_4)

panel_47 = Panel("""0.0
5.0
1.0""")
panel_48 = Panel("""-2.0
20.0
0.0""")
panel_49 = Panel("""-15.0
0.0
20""")
panel_50 = Panel("""-5.0
0.0
5.0""")
panel_51 = Panel("""0.0
20.0
0.0""")
panel_52 = Panel("""0.0
10.0
0.0""")
panel_53 = Panel("""-5.0
0.0
10""")
panel_54 = Panel("""-20.0
0.0
10""")
pt = ConstructPoint(XCoordinate=panel_54, YCoordinate="0.0", ZCoordinate=panel_52)
number_slider_5 = Slider(2, range=0..10)
pt_2 = ConstructPoint(XCoordinate=panel_49, YCoordinate="10.0", ZCoordinate=panel_47)
pt_3 = ConstructPoint(XCoordinate=panel_53, YCoordinate="25.0", ZCoordinate=panel_51)
pt_4 = ConstructPoint(XCoordinate=panel_50, YCoordinate="35.0", ZCoordinate=panel_48)
merge_5 = Merge(Data1=pt)
nurbs_17 = NurbsCurve(Vertices=pt, Degree=number_slider_5, Periodic=False)  # -> Curve, Length, Domain
nurbs_18 = NurbsCurve(Vertices=pt_2, Degree=number_slider_5, Periodic=False)  # -> Curve, Length, Domain
nurbs_19 = NurbsCurve(Vertices=pt_3, Degree=number_slider_5, Periodic=False)  # -> Curve, Length, Domain
nurbs_20 = NurbsCurve(Vertices=pt_4, Degree=number_slider_5, Periodic=False)  # -> Curve, Length, Domain
nurbs_21 = NurbsCurve(Vertices=merge_5, Degree=number_slider_5, Periodic="true")  # -> Curve, Length, Domain
merge_6 = Merge(Data1=graft(pt), Data2=graft(pt_2), Data3=graft(pt_3), Data4=graft(pt_4))
cp = ControlPoints(Curve=nurbs_17.Curve)  # -> Points, Weights, Knots
merge_7 = Merge(Data1=nurbs_17.Curve, Data2=nurbs_18.Curve, Data3=nurbs_19.Curve, Data4=nurbs_20.Curve)
cp_2 = ControlPoints(Curve=nurbs_21.Curve)  # -> Points, Weights, Knots
curvepoint = PointOnCurve(nurbs_21.Curve, parameter=0)
curvepoint_2 = PointOnCurve(nurbs_21.Curve, parameter=1)
intcrv = Interpolate(Vertices=merge_6, Degree=3, Periodic=False, KnotStyle=Slider(2, range=0..2))  # -> Curve, Length, Domain
loft_opt_5 = LoftOptions(Closed=False, Adjust=False, Rebuild=0, Refit=0, Type=Slider(5, range=0..10))
equals = Equality(FirstNumber=curvepoint_2, SecondNumber=curvepoint)  # -> Equality, Inequality
cp_3 = ControlPoints(Curve=intcrv.Curve)  # -> Points, Weights, Knots
panel_55 = Panel(equals.Equality)
panel_56 = Panel("""{0.5,0.5,0.0}
{0.1,0.1,0.0}
{1.0,1.0,0.0}""")
loft_5 = Loft(Curves=merge_7, Options=loft_opt_5)
pt_5 = ConstructPoint(XCoordinate=Slider(0, range=0..1), YCoordinate=Slider(0, range=0..1), ZCoordinate=0)
evalsrf_6 = EvaluateSurface(Surface=reparameterize(loft_5), Point=pt_5)  # -> Point, Normal, UDirection, VDirection, Frame
srfpt_6 = SurfacePoints(Surface=loft_5)  # -> Points, Weights, Greville, UCount, VCount
panel_57 = Panel([srfpt_6.VCount, srfpt_6.UCount])
panel_58 = Panel(evalsrf_6.Point)
item_5 = ListItem(List=panel_58, Index=Slider(1, range=0..10), Wrap=True)
panel_59 = Panel(item_5)
