# Grasshopper definition GHDebug_Surface.gh (Grasshopper 1.0.7)

# ---- group: LoftStreesTest
panel = Panel("""{0, 2.5, 0}
{3, 2.5, 0}
{5, 2.5, 2}
{6, 2.5, -1}
{8, 2.5, 0}
{10, 2.5, 0}""")
panel_2 = Panel("""{0, 5, 0}
{2, 5, 0}
{4, 5, 0}
{6, 5, 2}
{8, 5, 0}
{10, 5, 0}""")
panel_3 = Panel("""{0, 7.5, 0}
{2, 7.5, 0}
{4, 7.5, 2}
{5, 7.5, -1}
{7, 7.5, 0}
{10, 7.5, 0}""")
panel_4 = Panel("""{0, 10, 0}
{1, 10, 0}
{4, 10, -1.5}
{5, 10, 4}
{7, 10, -1.5}
{10, 10, 0}""")
ln = Line(StartPoint="{0,0,0}", EndPoint="{10,0,0}")
pline = PolyLine(Vertices=panel_2, Closed=False)
nurbs = NurbsCurve(Vertices=panel, Degree="2", Periodic=False)  # -> Curve, Length, Domain
nurbs_2 = NurbsCurve(Vertices=panel_4, Degree="3", Periodic=False)  # -> Curve, Length, Domain
nurbs_3 = NurbsCurve(Vertices=panel_3, Degree="2", Periodic=False)  # -> Curve, Length, Domain
merge = Merge(Data1=ln, Data2=nurbs.Curve, Data3=pline, Data4=nurbs_3.Curve, Data5=nurbs_2.Curve)
loft = Loft(Curves=merge, Options={Adjust=False, Closed=False, LoftEnds=0, LoftSimp=1, LoftType=0, Rebuild=24, Refit=0.01})
evalsrf = EvaluateSurface(Surface=reparameterize(loft), Point="{0.5,0.5,0.0}")  # -> Point, Normal, UDirection, VDirection, Frame
panel_5 = Panel(evalsrf.Point)

# ---- group: SurfaceFrom4Points
# All these definitions were used to convalidate and developed the NurbsSurface tests.
srf4pt = _4PointSurface(CornerA="{0.0, 0.0, 0.0}", CornerB="{10.0, 0.0, 0.0}", CornerC="{10.0, 10.0, 2.0}", CornerD="{0.0, 10.0, 4.0}")  # -> reparameterize(Surface)

# ----
panel_6 = Panel("""0 = UDirection
1 = VDirection""")

# ---- group: SurfaceFromAGridOfPoints
srf = Surface(reparameterize(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))
srfpt = SurfacePoints(Surface=srf)  # -> Points, Weights, Greville, UCount, VCount

# ----
srfpt_2 = SurfacePoints(Surface=srf4pt)  # -> Points, Weights, Greville, UCount, VCount
panel_7 = Panel(srfpt.Points)
panel_8 = Panel(srfpt.Weights)
panel_9 = Panel(srfpt_2.Points)

# ---- group: Split
c_script = CSharpScript(srf=srf)  # -> out, bothSplits; inputs srf: Surface
# ---------- c_script: C# usings ----------
using System.Linq;
# ---------- c_script: C# ----------
    var split1 = srf.Split(1, 0.5);
    var srfs = split1.SelectMany(s => s.Split(0, 0.5)).ToList();
    bothSplits = srfs;
# ---------- end c_script ----------
c_script_2 = CSharpScript(srf=srf)  # -> out, surfsV, surfsU; inputs srf: Surface
# ---------- c_script_2: C# ----------
    surfsV = srf.Split(1, 0.5);
    surfsU = srf.Split(0, 0.5);
# ---------- end c_script_2 ----------
srfpt_3 = SurfacePoints(Surface=c_script.bothSplits)  # -> Points, Weights, Greville, UCount, VCount
srf_2 = Surface(reparameterize([c_script_2.surfsV, c_script_2.surfsU]))
srfpt_4 = SurfacePoints(Surface=c_script_2.surfsU)  # -> Points, Weights, Greville, UCount, VCount
srfpt_5 = SurfacePoints(Surface=c_script_2.surfsV)  # -> Points, Weights, Greville, UCount, VCount
panel_10 = Panel(srfpt_3.Points)
panel_11 = Panel(srfpt_5.Points)
panel_12 = Panel(srfpt_4.Points)
panel_13 = Panel(srfpt_5.UCount)
panel_14 = Panel(srfpt_5.VCount)
panel_15 = Panel(srfpt_4.UCount)
panel_16 = Panel(srfpt_4.VCount)
panel_17 = Panel(srfpt_3.Weights)
panel_18 = Panel(srfpt_4.Weights)
panel_19 = Panel(srfpt_5.Weights)
evalsrf_2 = EvaluateSurface(Surface=reparameterize(c_script.bothSplits), Point="{0.5,0.5,0.0}")  # -> Point, Normal, UDirection, VDirection, Frame
evalsrf_3 = EvaluateSurface(Surface=srf_2, Point="{0.5,0.5,0.0}")  # -> Point, Normal, UDirection, VDirection, Frame
panel_20 = Panel(evalsrf_2.Point)
panel_21 = Panel(evalsrf_3.Point)

# ---- group: LoftSurface
number_slider = Slider(2, range=0..10)
panel_22 = Panel("""{-5.0, 25.0, 0.0}
{0.0, 25.0, 20.0}
{10.0, 25.0, 0.0}""")
panel_23 = Panel("""{-20.0, 0.0, 0.0}
{0.0, 0.0, 10.0}
{10.0, 0.0, 0.0}""")
panel_24 = Panel("""{-15.0, 10.0, 0.0}
{0.0, 10.0, 5.0}
{20.0, 10.0, 1.0}""")
panel_25 = Panel("""{-5.0, 35.0, -2.0}
{0.0, 35.0, 20.0}
{5.0, 35.0, 0.0}""")
loft_opt = LoftOptions(Closed=False, Adjust=False, Rebuild=0, Refit=0, Type=Slider(1, range=0..10))
nurbs_4 = NurbsCurve(Vertices=panel_23, Degree=number_slider, Periodic=False)  # -> Curve, Length, Domain
nurbs_5 = NurbsCurve(Vertices=panel_24, Degree=number_slider, Periodic=False)  # -> Curve, Length, Domain
nurbs_6 = NurbsCurve(Vertices=panel_22, Degree=number_slider, Periodic=False)  # -> Curve, Length, Domain
nurbs_7 = NurbsCurve(Vertices=panel_25, Degree=number_slider, Periodic=False)  # -> Curve, Length, Domain
nurbs_8 = NurbsCurve(Vertices=panel_25, Degree=number_slider, Periodic=True)  # -> Curve, Length, Domain
nurbs_9 = NurbsCurve(Vertices=panel_22, Degree=number_slider, Periodic=True)  # -> Curve, Length, Domain
nurbs_10 = NurbsCurve(Vertices=panel_23, Degree=number_slider, Periodic=True)  # -> Curve, Length, Domain
nurbs_11 = NurbsCurve(Vertices=panel_24, Degree=number_slider, Periodic=True)  # -> Curve, Length, Domain
merge_2 = Merge(Data1=nurbs_4.Curve, Data2=nurbs_5.Curve, Data3=nurbs_6.Curve, Data4=nurbs_7.Curve)
merge_3 = Merge(Data1=nurbs_10.Curve, Data2=nurbs_11.Curve, Data3=nurbs_9.Curve, Data4=nurbs_8.Curve)
panel_26 = Panel("""{0.5,0.5,0.0}
{0.1,0.1,0.0}
{1.0,1.0,0.0}""")
loft_2 = Loft(Curves=merge_3, Options=loft_opt)
loft_3 = Loft(Curves=merge_2, Options=loft_opt)
evalsrf_4 = EvaluateSurface(Surface=reparameterize(loft_3), Point=panel_26)  # -> Point, Normal, UDirection, VDirection, Frame
evalsrf_5 = EvaluateSurface(Surface=reparameterize(loft_2), Point=panel_26)  # -> Point, Normal, UDirection, VDirection, Frame
panel_27 = Panel(evalsrf_5.Point)
panel_28 = Panel(evalsrf_4.VDirection)
panel_29 = Panel(evalsrf_4.Point)

# ---- group: PointAt and VectorAt
panel_30 = Panel("""{0.5,0.5,0.0}
{0.1,0.1,0.0}
{1,1,0.0}
{0.3,0.5,0.0}""")
evalsrf_6 = EvaluateSurface(Surface=srf, Point=panel_30)  # -> Point, Normal, UDirection, VDirection, Frame
panel_31 = Panel(evalsrf_6.VDirection)
panel_32 = Panel(evalsrf_6.Point)

# ---- group: RationalDerivatives
c_script_3 = CSharpScript(srf=srf)  # -> out, derv0, dervs; inputs srf: Surface
# ---------- c_script_3: C# ----------
    Point3d pt;
    Vector3d[] derivis;
    srf.Evaluate(0.3, 0.5, 2, out pt, out derivis);
    dervs = derivis;
    derv0 = pt;
# ---------- end c_script_3 ----------
unit = UnitVector(Vector=c_script_3.dervs)
item = ListItem(List=unit, Index=0, Wrap=True)
panel_33 = Panel(c_script_3.derv0)
panel_34 = Panel(unit)
vdis = VectorDisplay(Anchor=c_script_3.derv0, Vector=item)

# ---- group: RuledSurface
panel_35 = Panel("""{0, 0, 0}
{0, 0, 5}
{5, 0, 5}
{5, 0, 0}
{10, 0, 0}""")
panel_36 = Panel("""{0.1, 0.1, 0}
{0.5, 0.5, 0}
{1.0, 1.0, 0}""")
Y = UnitY(Factor=10)
move = Move(Geometry=panel_35, Motion=Y)  # -> Geometry, Transform
pline_2 = PolyLine(Vertices=panel_35, Closed=False)
nurbs_12 = NurbsCurve(Vertices=panel_35, Degree="3", Periodic=False)  # -> Curve, Length, Domain
nurbs_13 = NurbsCurve(Vertices=move.Geometry, Degree="2", Periodic=False)  # -> Curve, Length, Domain
rulesrf = RuledSurface(CurveA=nurbs_12.Curve, CurveB=nurbs_13.Curve)
evalsrf_7 = EvaluateSurface(Surface=reparameterize(rulesrf), Point=panel_36)  # -> Point, Normal, UDirection, VDirection, Frame
srfpt_6 = SurfacePoints(Surface=rulesrf)  # -> Points, Weights, Greville, UCount, VCount
panel_37 = Panel(evalsrf_7.Point)
panel_38 = Panel(srfpt_6.Points)

# ---- group: SurfaceIsocurve
c_script_4 = CSharpScript(srf=srf)  # -> out, isoV, isoU; inputs srf: Surface
# ---------- c_script_4: C# ----------
    isoV = srf.ToNurbsSurface().IsoCurve(1, 0.3);
    isoU = srf.ToNurbsSurface().IsoCurve(0, 0.3);
# ---------- end c_script_4 ----------
eval = EvaluateCurve(Curve=reparameterize(c_script_4.isoU), Parameter=0.5)  # -> Point, Tangent, Angle
cp = ControlPoints(Curve=c_script_4.isoU)  # -> Points, Weights, Knots
cp_2 = ControlPoints(Curve=c_script_4.isoV)  # -> Points, Weights, Knots
panel_39 = Panel(cp_2.Points)
panel_40 = Panel(cp_2.Weights)
panel_41 = Panel(cp.Points)
panel_42 = Panel(cp.Weights)
panel_43 = Panel(eval.Point)

# ---- group: ClosestPt and ClosestParameters
panel_44 = Panel("""{2.5, 7, 5}
{2.5, 1.5, 2}
{9, 2.5, 1}
{5, 5, 1}""")
pt = Point(panel_44)
c_script_5 = CSharpScript(testPt=pt, srf=srf)  # -> out, pt, uv; inputs testPt: Point3d, srf: Surface
# ---------- c_script_5: C# ----------
    Point3d ptAt;
    Vector3d[] derivs;
    double u; double v;
    srf.ClosestPoint(testPt, out u, out v);
    uv = new string[]{u.ToString(), v.ToString()};
    srf.Evaluate(u, v, 1, out ptAt, out derivs);
    pt = ptAt;
# ---------- end c_script_5 ----------
panel_45 = Panel(c_script_5.pt)
panel_46 = Panel(c_script_5.uv)

# ---- group: Reverse Surface
c_script_6 = CSharpScript(srf=srf)  # -> out, rev0, rev1; inputs srf: Surface
# ---------- c_script_6: C# ----------
    rev0 = srf.Reverse(0);
    rev1 = srf.Reverse(1);
# ---------- end c_script_6 ----------
srfpt_7 = SurfacePoints(Surface=c_script_6.rev0)  # -> Points, Weights, Greville, UCount, VCount
srfpt_8 = SurfacePoints(Surface=c_script_6.rev1)  # -> Points, Weights, Greville, UCount, VCount
panel_47 = Panel(srfpt_7.Points)
panel_48 = Panel(srfpt_8.Points)

# ---- group: ExtrudedSurface
Y_2 = UnitY(Factor=1)  # -> expr("x*10", UnitVector)
extr = Extrude(Base=nurbs_12.Curve, Direction=Y_2)
srfpt_9 = SurfacePoints(Surface=extr)  # -> Points, Weights, Greville, UCount, VCount
panel_49 = Panel(srfpt_9.Points)

# ---- group: RevolvedSurface
xz = XZPlane(Origin=Point(0, 0, 0))
deplane = DeconstructPlane(Plane=xz)  # -> Origin, XAxis, YAxis, ZAxis
pl = ConstructPlane(Origin=deplane.Origin, XAxis=deplane.YAxis, YAxis=deplane.XAxis)
panel_50 = Panel("""Pi * 0.25
2 * Pi""")
dom = ConstructDomain(DomainStart=0, DomainEnd="Pi * 0.5")
dom_2 = ConstructDomain(DomainStart="0", DomainEnd="Pi")
pt_2 = Point(Point(0, 0, 0))
pt_3 = Point(Point(0, 0, 1))
pt_4 = Point(Point(1, 0, 0))
arc = Arc(Plane=xz, Radius=1, Angle=dom)  # -> Arc, Length
arc_2 = Arc(Plane=pl, Radius=1, Angle=dom_2)  # -> Arc, Length
ln_2 = Line(StartPoint=pt_2, EndPoint=pt_3)
ln_3 = Line(StartPoint=pt_4, EndPoint=pt_3)
dom_3 = ConstructDomain(DomainStart=0, DomainEnd=panel_50)
revsrf = Revolution(Curve=arc_2.Arc, Axis=ln_2, Domain=dom_3)
srfpt_10 = SurfacePoints(Surface=revsrf)  # -> Points, Weights, Greville, UCount, VCount
panel_51 = Panel(srfpt_10.Points)

# ---- group: Sweep
panel_52 = Panel("""{5, 0, 0}
{5, 5, 0}
{0, 5, 0}
{0, 5, 5}
{5, 5, 5}""")
panel_53 = Panel("""{4, 0, 1}
{5, 0, 0}
{6, 0, 1}""")
nurbs_14 = NurbsCurve(Vertices=panel_52, Degree=3, Periodic=False)  # -> Curve, Length, Domain
nurbs_15 = NurbsCurve(Vertices=panel_53, Degree=2, Periodic=False)  # -> Curve, Length, Domain
swp1 = Sweep1(Rail=nurbs_14.Curve, Sections=nurbs_15.Curve, Miter=1)
srfpt_11 = SurfacePoints(Surface=swp1)  # -> Points, Weights, Greville, UCount, VCount
partition = PartitionList(List=srfpt_11.Points, Size=3)
item_2 = ListItem(List=partition, Index=1, Wrap=True)
crv_cp = CurveClosestPoint(Point=flatten(item_2), Curve=nurbs_14.Curve)  # -> Point, Parameter, Distance
pframe = PerpFrame(Curve=nurbs_14.Curve, Parameter=crv_cp.Parameter)
item_3 = ListItem(List=pframe, Index=0, Wrap=True)
orient = Orient(Geometry=nurbs_15.Curve, Source=item_3, Target=pframe)  # -> Geometry, Transform
